# Grasshopper definition ha2.gh (Grasshopper 1.0.7)
# plug-ins: Heteroptera, Pufferfish, MyComponents, Anemone

pi = Pi(Factor=1)
number_slider = Slider(200, range=0..1000)
division = Division(A=pi, B=Slider(2, range=0..10))
rectangle = Rectangle(Plane=PlaneXY(0, 0, 0), XSize=number_slider, YSize=number_slider, Radius=0)  # -> Rectangle, Length
srf = Surface(rectangle.Rectangle)
pt = Point([<point referenced from the Rhino model> x2])
Z = UnitZ(Factor=1)
substrate = Substrate(Border=rectangle.Rectangle, Count=Slider(30, range=0..100), Angles=division, Deviation=0, Seed=Slider(22, range=0..100))
neg = Negative(Value=Z)
number_slider_2 = Slider(14, range=0..100)
extr = Extrude(Base=substrate, Direction=Z)
cluster = Cluster_2(geo=substrate, pt=pt)
division_2 = Division(A=neg, B="2")
move = Move(Geometry=extr, Motion=division_2)  # -> Geometry, Transform
geo = Geometry(cluster)
splitmul = SplitBrepMultiple(Brep=srf, Cutters=move.Geometry)
cluster_2 = Cluster_3(X=number_slider_2, Y=Slider(3, range=0..100), relay=geo)
cluster_3 = Cluster_4(C=geo)
center = Center(Geometry=splitmul)  # -> Center, Dimension
circle = CircleCNR(Center=cluster_3, Normal=Vector(0, 0, 1), Radius=number_slider_2)
scale = Scale(Geometry=splitmul, Center=center.Center, Factor=Slider(0.84, range=0..1))  # -> Geometry, Transform
geo_2 = Geometry(geo)
geo_3 = Geometry(cluster)
trim = TrimWithRegions(Curve=geo_2, Regions=circle)  # -> Inside, Outside
smoothpline = SmoothPolyline(Polyline=geo_3, Strength=1, Times=1)
cluster_4 = Cluster(B=scale.Geometry)
geo_4 = Geometry(trim.Inside)
explode = Explode(Curve=smoothpline, Recursive=True)  # -> Segments, Vertices
join = JoinCurves(Curves=cluster_4, Preserve=False)
intcrv = Interpolate(Vertices=explode.Vertices, Degree=3, Periodic=False, KnotStyle=1)  # -> Curve, Length, Domain
midpt = CurveMiddle(Curve=join)
pframes = PerpFrames(Curve=intcrv.Curve, Count=intcrv.Length, Align=True)  # -> Frames, Parameters
Z_2 = UnitZ(Factor=1)
edges = BrepEdges(Brep=scale.Geometry)  # -> Naked, Interior, NonManifold
align = AlignPlane(Plane=pframes.Frames, Direction=Z_2)  # -> Plane, Angle
divide = DivideCurve(Curve=geo_4, Count=Slider(8, range=0..10), Kinks=False)  # -> flatten(Points), Tangents, Parameters
pt_2 = ConstructPoint(XCoordinate=0, YCoordinate=0, ZCoordinate=0)
circle_2 = CircleCNR(Center=pt_2, Normal=Vector(0, 0, 1), Radius=1)
join_2 = JoinCurves(Curves=edges.Naked, Preserve=False)  # -> flatten(Curves)
divide_2 = DivideCurve(Curve=circle_2, Count=10, Kinks=False)  # -> Points, Tangents, Parameters
deplane = DeconstructPlane(Plane=align.Plane)  # -> Origin, XAxis, YAxis, ZAxis
vec2pt = Vector2Pt(PointA=pt_2, PointB=divide_2.Points, Unitize=False)  # -> Vector, Length
pl = ConstructPlane(Origin=deplane.Origin, XAxis=deplane.ZAxis, YAxis=deplane.YAxis)
line = LineSDL(Start=graft(divide.Points), Direction=vec2pt.Vector, Length=1)
item = ListItem(List=pl, Index=0, Wrap=True)
geo_5 = Geometry(cluster_2)
geo_6 = Geometry(scale.Geometry)
orient = Orient(Geometry=geo_5, Source=item, Target=pl)  # -> graft(Geometry), Transform
edges_2 = BrepEdges(Brep=geo_6)  # -> Naked, Interior, NonManifold
ivray = IsoVistRay(Sample=line, Radius=Slider(24, range=0..100), Obstacles=join_2)  # -> Point, Distance, Index
join_3 = JoinCurves(Curves=edges_2.Naked, Preserve=False)
project = Project(Geometry=join_3, Plane=PlaneXY(0, 0, 0))  # -> flatten(Geometry), Transform
project_2 = Project(Geometry=orient.Geometry, Plane=PlaneXY(0, 0, 0))  # -> Geometry, Transform
fastloopstart = FastLoopStart(Iterations=Slider(9, range=0..10), Data=project_2.Geometry)  # -> port, Counter, Data
project_3 = Project(Geometry=fastloopstart.Data, Plane=PlaneXY(0, 0, 0))  # -> Geometry, Transform
sort = SortList(Keys=ivray.Distance, ValuesA=ivray.Distance)  # -> Keys, ValuesA
project_4 = Project(Geometry=join_3, Plane=PlaneXY(0, 0, 0))  # -> flatten(Geometry), Transform
avr = Average(Input=sort.ValuesA)
trim_2 = TrimWithRegions(Curve=project_3.Geometry, Regions=project.Geometry)  # -> simplify(Inside), Outside
multiplication = Multiplication(A=avr, B=Slider(2, range=0..10))
clscrv = CloseCurve(Curve=trim_2.Inside, CloseType=0, Bulge=0.5, Tolerance=0)  # -> simplify(Closed), R
geo_7 = Geometry(project_3.Geometry)
fastloopstart_2 = FastLoopStart(Iterations=Slider(7, range=0..10), Data=project_2.Geometry)  # -> port, Counter, Data
ivray_2 = IsoVistRay(Sample=line, Radius=multiplication, Obstacles=join_2)  # -> Point, Distance, Index
merge = Merge(Data1=simplify(project_3.Geometry), Data2=simplify(clscrv.Closed))
ccx = CurveCurve(CurveA=fastloopstart_2.Data, CurveB=project_4.Geometry)  # -> simplify(Points), ParamsA, ParamsB
center_2 = Center(Geometry=geo_7)  # -> simplify(Center), Dimension
center_3 = Center(Geometry=clscrv.Closed)  # -> simplify(Center), Dimension
trim_3 = TrimTree(Tree=ccx.Points, Depth=1)
lng = ListLength(List=merge)
equals = Equality(FirstNumber=lng, SecondNumber="1")  # -> Equality, Inequality
lng_2 = ListLength(List=trim_3)
equalst = EqualityWithinTolerance(FirstNumber=ivray_2.Distance, SecondNumber=multiplication, Tolerance=0.001)  # -> Equality, Inequality
vec2pt_2 = Vector2Pt(PointA=center_3.Center, PointB=center_2.Center, Unitize=False)  # -> Vector, Length
dispatch = Dispatch(List=merge, DispatchPattern=equals.Equality)  # -> ListA, ListB
equals_2 = Equality(FirstNumber=lng_2, SecondNumber="0")  # -> Equality, Inequality
dispatch_2 = Dispatch(List=ivray_2.Point, DispatchPattern=equalst.Equality)  # -> ListA, ListB
dispatch_3 = Dispatch(List=line, DispatchPattern=equalst.Equality)  # -> ListA, ListB
item_2 = ListItem(List=vec2pt_2.Vector, Index=0, Wrap=True)
cull_i = CullIndex(List=dispatch.ListB, Indices="0", Wrap=True)  # -> simplify(List)
dispatch_4 = Dispatch(List=fastloopstart_2.Data, DispatchPattern=equals_2.Equality)  # -> ListA, ListB
dispatch_5 = Dispatch(List=trim_3, DispatchPattern=equals_2.Equality)  # -> ListA, ListB
geo_8 = Geometry(dispatch_2.ListB)
curvepoint = PointOnCurve(dispatch_3.ListB, parameter=0)
merge_2 = Merge(Data1=dispatch.ListA, Data2=cull_i)  # -> simplify(Result)
center_4 = Center(Geometry=merge_2)  # -> Center, Dimension
center_5 = Center(Geometry=dispatch_5.ListB, forall=True)  # -> Center, Dimension
center_6 = Center(Geometry=dispatch_4.ListB, forall=True)  # -> Center, Dimension
ln = Line(StartPoint=curvepoint, EndPoint=geo_8)
geo_9 = Geometry(dispatch_4.ListB)
vec2pt_3 = Vector2Pt(PointA=simplify(center_4.Center), PointB=simplify(center_2.Center), Unitize=False)  # -> Vector, Length
item_3 = ListItem(List=vec2pt_3.Vector, Index=0, Wrap=True)
move_2 = Move(Geometry=project_3.Geometry, Motion=item_3)  # -> simplify(Geometry), Transform
len = Length(Curve=ln)
vec2pt_4 = Vector2Pt(PointA=center_5.Center, PointB=center_6.Center, Unitize=True)  # -> Vector, Length
geo_10 = Geometry(geo_8)
index = ItemIndex(List=len, Item=len)
geo_11 = Geometry(line)
center_7 = Center(Geometry=move_2.Geometry)  # -> flatten(Center), Dimension
sort_2 = SortList(Keys=len, ValuesA=index)  # -> Keys, ValuesA
move_3 = Move(Geometry=geo_9, Motion=vec2pt_4.Vector)  # -> Geometry, Transform
pline = PolyLine(Vertices=center_7.Center, Closed=False)
item_4 = ListItem(List=sort_2.ValuesA, Index=0, Wrap=True)
smoothpline_2 = SmoothPolyline(Polyline=pline, Strength=1, Times=Slider(8, range=0..10))
addition = Addition(A=item_4, B=Slider(4, range=0..10))
geo_12 = Geometry(dispatch_4.ListA)
explode_2 = Explode(Curve=smoothpline_2, Recursive=True)  # -> Segments, Vertices
fastloopend = FastLoopEnd(port=fastloopstart_2.port, Exit=False, Data=move_3.Geometry, RecordData=False, TimeOutVal=0)
item_5 = ListItem(List=ln, Index=addition, Wrap=True)
item_6 = ListItem(List=ln, Index=item_4, Wrap=True)
geo_13 = Geometry(move_3.Geometry)
vec2pt_5 = Vector2Pt(PointA=center_7.Center, PointB=explode_2.Vertices, Unitize=False)  # -> graft(Vector), Length
merge_3 = Merge(Data1=item_6, Data2=item_5)
move_4 = Move(Geometry=move_2.Geometry, Motion=vec2pt_5.Vector)  # -> Geometry, Transform
join_4 = JoinCurves(Curves=merge_3, Preserve=False)
center_8 = Center(Geometry=join_4)  # -> simplify(flatten(Center)), Dimension
fastloopend_2 = FastLoopEnd(port=fastloopstart.port, Exit=False, Data=move_4.Geometry, RecordData=False, TimeOutVal=0)
geo_14 = Geometry(fastloopend_2)
sort_3 = SequentialPointSorter(Points=center_8.Center)
mesh = Mesh(flatten(geo_14))
pline_2 = PolyLine(Vertices=sort_3, Closed=False)
smoothpline_3 = SmoothPolyline(Polyline=pline_2, Strength=1, Times=Slider(4, range=0..10))
cp = PolycurveKinkBysectorPlane(Polycurve=smoothpline_3)  # -> MyCurve, Bisectors
item_7 = ListItem(List=mesh, Index=Slider(146, range=0..200), Wrap=True)
deplane_2 = DeconstructPlane(Plane=cp.MyCurve)  # -> Origin, XAxis, YAxis, ZAxis
pl_2 = ConstructPlane(Origin=deplane_2.Origin, XAxis=Vector(1, 0, 0), YAxis=Vector(0, 1, 0))

# ==== cluster Cluster
B = ClusterInput()
edges = BrepEdges(Brep=B)  # -> Naked, Interior, NonManifold
len = Length(Curve=edges.Naked)
multiplication = Multiplication(A=len, B=Slider(1, range=0..10))
divide = DivideCurve(Curve=edges.Naked, Count=multiplication, Kinks=False)  # -> flatten(Points), Tangents, Parameters
division = Division(A=len, B=multiplication)  # -> flatten(Result)
cullpt = CullDuplicates(Points=divide.Points, Tolerance=0.1, CullMode=1)  # -> Points, Indices, Valence
avr = Average(Input=division)
voronoi = Voronoi(Points=cullpt.Points, BruteForceOverride=False)
explode = Explode(Curve=voronoi, Recursive=True)  # -> Segments, Vertices
len_2 = Length(Curve=explode.Segments)
equalst = EqualityWithinTolerance(FirstNumber=avr, SecondNumber=len_2, Tolerance=Slider(1, range=0..1))  # -> Equality, Inequality
dispatch = Dispatch(List=explode.Segments, DispatchPattern=equalst.Equality)  # -> ListA, ListB
geo = Geometry(flatten(dispatch.ListA))
geo_2 = Geometry(dispatch.ListB)
geo_3 = Geometry(dispatch.ListA)
midpt = CurveMiddle(Curve=geo)
cullpt_2 = CullDuplicates(Points=midpt, Tolerance=0.1, CullMode=1)  # -> Points, Indices, Valence
item = ListItem(List=geo, Index=cullpt_2.Indices, Wrap=True)
i = ClusterOutput(item)

# ==== cluster Cluster_2
geo = ClusterInput()
geo_2 = Geometry(geo)
crv = Curve(reparameterize(geo_2))
geo_3 = Geometry(simplify(graft(crv)))
geo_4 = Geometry(flatten(crv))
ccx = CurveCurve(CurveA=geo_3, CurveB=geo_4)  # -> Points, simplify(ParamsA), ParamsB
trim = TrimTree(Tree=ccx.ParamsA, Depth=1)
pt = ClusterInput()
equals = Equality(FirstNumber=trim, SecondNumber=["0", "1"])  # -> Equality, Inequality
dispatch = Dispatch(List=trim, DispatchPattern=equals.Equality)  # -> ListA, ListB
pt_2 = Point(pt)
shatter = Shatter(Curve=geo_3, Parameters=dispatch.ListB)  # -> flatten(Segments)
pline = PolyLine(Vertices=pt_2, Closed=False)
len = Length(Curve=shatter)
division = Division(A=len, B=Slider(4, range=0..10))
addition = Addition(A="1", B=division)
geo_5 = Geometry(shatter)
cloud = CloudDisplay(Points=pt_2, Colours=RGB(255, 20, 147), Size=Slider(13, range=0..100), SpriteType=0)
divide = DivideCurve(Curve=shatter, Count=addition, Kinks=False)  # -> Points, Tangents, Parameters
clean = CleanTree(RemoveNulls=True, RemoveInvalid=True, RemoveEmpty=False, Tree=divide.Points)
pline_2 = PolyLine(Vertices=clean, Closed=False)
explode = Explode(Curve=pline_2, Recursive=True)  # -> flatten(Segments), Vertices
geo_6 = Geometry(explode.Segments)
shortwalk = ShortestWalk(Curves=explode.Segments, WantedPath=pline)  # -> ShortestWalk, Succession, Direction, Length
W = ClusterOutput(shortwalk.ShortestWalk)

# ==== cluster Cluster_3
relay = ClusterInput()
X = ClusterInput()
Y = ClusterInput()
rectangle = Rectangle(Plane=relay, XSize=X, YSize=Y, Radius=0)  # -> Rectangle, Length
center = Center(Geometry=rectangle.Rectangle)  # -> Center, Dimension
curvepoint = PointOnCurve(relay, parameter=0)
orient = Orient(Geometry=rectangle.Rectangle, Source=center.Center, Target=curvepoint)  # -> Geometry, Transform
G = ClusterOutput(orient.Geometry)

# ==== cluster Cluster_4
C = ClusterInput()
join = JoinCurves(Curves=C, Preserve=False)
splitty = AngleThresholdCurveExplode(PolyCurve=join, Angle=Slider(0.1, range=0..1))
end = EndPoints(Curve=splitty)  # -> Start, End
merge = Merge(Data1=end.Start, Data2=end.End)  # -> simplify(Result)
cullpt = CullDuplicates(Points=merge, Tolerance=0.1, CullMode=2)  # -> Points, Indices, Valence
cull_i = CullIndex(List=merge, Indices=cullpt.Indices, Wrap=True)
cullpt_2 = CullDuplicates(Points=cull_i, Tolerance=0.1, CullMode=3)  # -> Points, Indices, Valence
P = ClusterOutput(cullpt_2.Points)
